# Grasshopper definition path_test.gh (Grasshopper 1.0.7)

dimension = GetInteger(AtLeast=1, AtMost=1, Maximum=2147483647, Minimum=-2147483648)
python = GhPythonScript()  # -> out, a
# ---------- python: Python ----------
import os

a = os.getcwd()
# ---------- end python ----------
context_print = ContextPrint(Text=python.a)
